# Grasshopper definition Day2_MovingParticle.gh (Grasshopper 1.0.7)
# plug-ins: Workshop

vec = VectorXYZ(XComponent=Slider(1, range=0..1), YComponent=Slider(0.5, range=0..1), ZComponent=0)  # -> Vector, Length
timer = Timer(TimerInterval=1, Target=mvprtc)  # disabled
mvprtc = MovingParticle(Reset=Button(), Velocity=vec.Vector)
