# Grasshopper definition Day3_MeshGrowth.gh (Grasshopper 1.0.7)
# plug-ins: Weaverbird, MeshGrowth

pt = Point(Point(-1, -1, 0))
pt_2 = Point(Point(1, 1, 0))
rec_2pt = Rectangle2Pt(Plane=PlaneXY(0, 0, 0), PointA=pt, PointB=pt_2, Radius=0)  # -> Rectangle, Length
mplane = MeshPlane(Boundary=rec_2pt.Rectangle, WidthCount="2", HeightCount="2")  # -> Mesh, Area
tri = Triangulate(Mesh=mplane.Mesh)  # -> Mesh, Count
c_script = CSharpScript(iMesh=tri.Mesh, iJitter="0.3")  # -> out, oMesh; inputs iMesh: Mesh, iJitter: Double
# ---------- c_script: C# ----------
    Random random = new Random();
    for (int i = 0; i < iMesh.Vertices.Count; i++)
    {
      Point3d v = new Point3d(iMesh.Vertices[i]);
      iMesh.Vertices.SetVertex(
        i,
        v.X + iJitter * (2.0 * random.NextDouble() - 1.0),
        v.Y + iJitter * (2.0 * random.NextDouble() - 1.0),
        v.Z + iJitter * (2.0 * random.NextDouble() - 1.0));
    }
    oMesh = iMesh;
# ---------- end c_script ----------
bending_resistance_weight = Slider(6, range=0..20)
edgelength_weight = Slider(0, range=0..10)
collision_distance = Slider(1, range=0..10)
collision_weight = Slider(4, range=0..10)
sub_iteration = Slider(1, range=0..20)
max_vertex_count = Panel("5000")
r_tree = BooleanToggle(True)
timer = Timer(TimerInterval=1, Target=meshgrowth)  # disabled
reset = Button()
grow = BooleanToggle(True)
starting_mesh = Mesh(c_script.oMesh)
meshgrowth = MeshGrowth(
    Reset=reset,
    StartingMesh=starting_mesh,
    SubiterationCount=sub_iteration,
    Grow=grow,
    MaxVertexCount=max_vertex_count,
    EdgeLengthConstraintWeight=edgelength_weight,
    CollisionDistance=collision_distance,
    CollisionWeight=collision_weight,
    BendingResistanceWeight=bending_resistance_weight,
    UseRTree=r_tree)
mesh = Mesh(meshgrowth)
wbloop = WeaverbirdsLoopSubdivision(MeshCurves=mesh, Level=Slider(3, range=0..3), SmoothNakedEdges=1)
preview = CustomPreview(Geometry=wbloop, Material=ColourSwatch(SwatchColor=RGB(255, 255, 255)))
