# Grasshopper definition Day3_UsingExternalLibrary.gh (Grasshopper 1.0.7)
# plug-ins: Weaverbird

pt = Point(Point(-0.9529820765, -1.251859291, 0))
pt_2 = Point(Point(0.9987959832, 1.077951599, 0))
rec_2pt = Rectangle2Pt(Plane=PlaneXY(0, 0, 0), PointA=pt, PointB=pt_2, Radius=0)  # -> Rectangle, Length
mplane = MeshPlane(Boundary=rec_2pt.Rectangle, WidthCount="3", HeightCount="3")  # -> Mesh, Area
tri = Triangulate(Mesh=mplane.Mesh)  # -> Mesh, Count
c_script = CSharpScript(iMesh=tri.Mesh, iJitter="0.2")  # -> out, oMesh; inputs iMesh: Mesh, iJitter: Double
# ---------- c_script: C# ----------
    Random random = new Random();
    for (int i = 0; i < iMesh.Vertices.Count; i++)
    {
      Point3d v = new Point3d(iMesh.Vertices[i]);
      iMesh.Vertices.SetVertex(
        i,
        v.X + iJitter * (2.0 * random.NextDouble() - 1.0),
        v.Y + iJitter * (2.0 * random.NextDouble() - 1.0),
        v.Z + iJitter * (2.0 * random.NextDouble() - 1.0));
    }
    oMesh = iMesh;
# ---------- end c_script ----------
bending_resistance_weight = Slider(3, range=0..20)
edgelength_weight = Slider(1, range=0..10)
collision_distance = Slider(1, range=0..10)
collision_weight = Slider(4, range=0..10)
sub_iteration = Slider(1, range=0..30)
max_vertex_count = Panel("2000")
r_tree = BooleanToggle(True)
reset = Button()
timer = Timer(TimerInterval=1, Target=c_script_2)  # disabled
grow = BooleanToggle(True)
starting_mesh = Mesh(c_script.oMesh)
c_script_2 = CSharpScript(
    iReset=reset,
    iStartingMesh=starting_mesh,
    iSubiterationCount=sub_iteration,
    iGrow=grow,
    iMaxVertexCount=max_vertex_count,
    iEdgeLengthConstraintWeight=edgelength_weight,
    iCollisionDistance=collision_distance,
    iCollisionWeight=collision_weight,
    iBendingResistanceWeight=bending_resistance_weight,
    iUseRTree=r_tree,
    Reference="C:\Users\po\AppData\Roaming\Grasshopper\Libraries\MeshGrowth.gha")  # -> out, oMesh; inputs iReset: Boolean, iStartingMesh: Mesh, iSubiterationCount: Int32, iGrow: Boolean, iMaxVertexCount: Int32, iEdgeLengthConstraintWeight: Double, iCollisionDistance: Double, iCollisionWeight: Double, iBendingResistanceWeight: Double, iUseRTree: Boolean
# ---------- c_script_2: C# usings ----------
using System.IO;
using System.Linq;
using System.Data;
using System.Drawing;
using System.Reflection;
using System.Windows.Forms;
using System.Xml;
using System.Xml.Linq;
using System.Runtime.InteropServices;

using Rhino.DocObjects;
using Rhino.Collections;
using GH_IO;
using GH_IO.Serialization;
using MeshGrowth;
# ---------- c_script_2: C# ----------
    if(iReset || system == null)
      system = new MeshGrowthSystem(iStartingMesh);

    system.Grow = iGrow;
    system.MaxVertexCount = iMaxVertexCount;
    system.EdgeLengthConstraintWeight = iEdgeLengthConstraintWeight;
    system.CollisionDistance = iCollisionDistance;
    system.CollisionWeight = iCollisionWeight;
    system.BendingResistanceWeight = iBendingResistanceWeight;
    system.UseRTree = iUseRTree;

    for(int i = 0;i < iSubiterationCount;i++)
      system.Update();

    oMesh = system.GetRhinoMesh();
# ---------- c_script_2: C# additional code ----------
  private MeshGrowthSystem system;
# ---------- end c_script_2 ----------
level = Slider(1, range=0..4)
mesh = Mesh(c_script_2.oMesh)
wbloop = WeaverbirdsLoopSubdivision(MeshCurves=mesh, Level=level, SmoothNakedEdges=1)
preview = CustomPreview(Geometry=wbloop, Material=ColourSwatch(SwatchColor=RGB(230, 230, 230)))
